# Grasshopper definition BroExempel.gh (Grasshopper 0.9.76)
# plug-ins: Karamba, MiStrAnGH

pt = ConstructPoint(XCoordinate=0, YCoordinate=0, ZCoordinate=0)
ln = Line()
srf = Surface(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)
srf_2 = Surface(<surface referenced from the Rhino model>)
number_slider = Slider(100, range=0..500)
scale = Scale(Geometry=srf, Center=Point(0, 0, 0), Factor=Slider(1, range=0..1))  # -> Geometry, Transform
srf_3 = Surface(scale.Geometry)
division = Division(A=number_slider, B=4)
sdivide = DivideSurface(Surface=srf_3, UCount=number_slider, VCount=division)  # -> Points, Normals, Parameters
mesh_uv = MeshSurface(Surface=srf_3, UCount=number_slider, VCount=division, Overhang=True, Equalize=False)
number_slider_2 = Slider(2000, range=0..2000)
tri = Triangulate(Mesh=mesh_uv)  # -> Mesh, Count
mesh = Mesh(tri.Mesh)
medges = MeshEdges(Mesh=mesh)  # -> NakedEdges, InteriorEdges, NonManifoldEdges
demesh = DeconstructMesh(Mesh=mesh)  # -> Vertices, Faces, Colours, Normals
tstat = TreeStatistics(Tree=sdivide.Points)  # -> Paths, Length, Count
lng = ListLength(List=tstat.Length)
division_2 = Division(A=lng, B=2)
medges_2 = MeshEdges(Mesh=tri.Mesh)  # -> NakedEdges, InteriorEdges, NonManifoldEdges
X = UnitX(Factor=number_slider_2)
item = ListItem(List=tstat.Paths, Index=0, Wrap=True)  # -> Item1, Item
Z = UnitZ(Factor=number_slider_2)
item_2 = ListItem(List=tstat.Paths, Index=division_2, Wrap=True)
meshtoshell = MeshToShellKaramba(Point=demesh.Vertices, Mesh=mesh, LDist=0.005)  # -> Point, Element, Info
number_slider_3 = Slider(10000, range=0..10000)
branch = TreeBranch(Tree=sdivide.Points, Path=item_2, MaintainPaths=True)
number_slider_4 = Slider(1000, range=0..1000000)
branch_2 = TreeBranch(Tree=sdivide.Points, Path=item.Item1, MaintainPaths=True)
branch_3 = TreeBranch(Tree=sdivide.Points, Path=item.Item, MaintainPaths=True)
bc_points = Point(flatten([branch_2, branch_3]))
cp = ClosestPoint(Point=bc_points, Cloud=demesh.Vertices)  # -> ClosestPoint, CPIndex, Distance
supp = SupportKaramba(PosInd=cp.CPIndex, menu=[buttons(on, on, on, on, on, on)])
number_slider_5 = Slider(1000000, range=0..1000000)
number_slider_6 = Slider(10, range=0..10)
lng_2 = ListLength(List=branch)
number_slider_7 = Slider(0.01, range=0..0.01)
division_3 = Division(A=lng_2, B=3)
number_slider_8 = Slider(9, range=0..10)
index = ItemIndex(List=meshtoshell.Point, Item=meshtoshell.Point)
matprops = MaterialPropertiesKaramba(
    ElementsIdentifiers=index,
    YoungsModulus_kN_cm2=21000,
    ShearModulus_kN_cm2=8076,
    SpecificWeight_kN_m3=Slider(0, range=0..100),
    CoefficientOfThermalExpansion_1_C=1e-05,
    YieldStrength_kN_cm2=Slider(500, range=0..1000),
    Name="S235")
shift = ShiftList(List=branch, Shift=division_3, Wrap=False)
neg = Negative(Value=division_3)
shift_2 = ShiftList(List=shift, Shift=neg, Wrap=False)
load_pts = Point(flatten(shift_2))
cp_2 = ClosestPoint(Point=load_pts, Cloud=demesh.Vertices)  # -> ClosestPoint, CPIndex, Distance
lng_3 = ListLength(List=shift_2)
division_4 = Division(A=Slider(100000, range=0..100000), B=lng_3)
bc = Point(flatten([branch_2, branch_3]))
dup = DuplicateData(Data=division_4, Number=lng_3, Order=True)
mesh_2 = Mesh(tri.Mesh)
cross_sections = CrossSectionsKaramba(Heights_cm=Slider(1, range=0..1), mode="Shell")
neg_2 = Negative(Value=dup)
Z_2 = UnitZ(Factor=neg_2)
force_vecs = Vector(Z_2)
division_5 = Division(A=force_vecs, B=1000)
loads = LoadsKaramba(ForceVector=division_5, Local=True, PosInd=cp_2.CPIndex, LCase=0, mode="Point")
assemble = AssembleModelKaramba(
    Point=meshtoshell.Point,
    Elem=meshtoshell.Element,
    Support=supp,
    Load=loads,
    CrossSection=cross_sections,
    Material=matprops,
    LimitDistance_m=0.005)  # -> Model, Info, Mass_kg, CenterOfGravity
analyzethi = AnalyzeThIKaramba(Model=assemble.Model)  # -> CalculatedModel, MaximumDisplacement_m, ResultingForceOfGravity_kN, ElasticEnergy_kNm
karamba = Panel(analyzethi.MaximumDisplacement_m)
pointload = MiStrAnPointload(Point=shift_2, ForceVector=Z_2)
nodedisp = NodalDisplacementsKaramba(AnalyzedModel=analyzethi.CalculatedModel)  # -> AnalyzedModel, NodalTranslations_m, NodalRotations_rad
support = CreateSupport(
    Point=bc,
    SupportInXDirection=True,
    SupportInYDirection=True,
    SupportInZDirection=True,
    SupportInXXDirection=True,
    SupportInYYDirection=True,
    SupportInZZDirection=True)
demesh_2 = DeconstructMesh(Mesh=mesh_2)  # -> Vertices, Faces, Colours, Normals
index_2 = ItemIndex(List=demesh_2.Faces, Item=demesh_2.Faces)
section = Section(IndexesOfFaces=index_2, LaminaThickness=Slider(0.01, range=0..0.01))
assemble_2 = MiStrAnAssembleStructure(Mesh=mesh_2, MiStrAnSupports=support, MiStrAnLoads=pointload, GeneratedSection=section)
modelview = ModelViewKaramba(Model=nodedisp.AnalyzedModel, LoadCaseFactorsForLinearSuperposition=1, IndexIncrementOfVisibleLoadcase=0)  # -> Model, DeformedMesh, DeformedAxes, DeformedModel
analyse = MiStrAnAnalyseStructure(Run=Toggle(True), MiStrAnStructure=assemble_2)  # -> Displacements, Rotations, Reactions, DeformedMesh, PrincipalStresses
multiplication = Multiplication(A=nodedisp.NodalTranslations_m, B=1000)
demesh_3 = DeconstructMesh(Mesh=mesh)  # -> Vertices, Faces, Colours, Normals
devec = DeconstructVector()  # -> XComponent, YComponent, ZComponent
devec_2 = DeconstructVector(Vector=nodedisp.NodalTranslations_m)  # -> XComponent, YComponent, ZComponent
vlen = VectorLength(Vector=analyse.Displacements)
move = Move(Geometry=demesh_3.Vertices, Motion=multiplication)  # -> Geometry, Transform
division_6 = Division(A=devec.ZComponent, B=devec_2.ZComponent)
conmesh = ConstructMesh(Vertices=move.Geometry, Faces=demesh_3.Faces)
sort = SortList(Keys=vlen)  # -> Keys, ValuesA
subtraction = Subtraction(A=division_6, B=1)
item_3 = ListItem(List=sort.Keys, Index=0, Wrap=True)  # -> Item1, Item
mistran = Panel(item_3.Item1)
division_7 = Division(A=karamba, B=mistran)  # -> flatten(Result)
panel = Panel(division_7)
panel_2 = Panel(division_6)
number_slider_9 = Slider(100, range=0..100)
demesh_4 = DeconstructMesh(Mesh=tri.Mesh)  # -> Vertices, Faces, Colours, Normals
vlen_2 = VectorLength(Vector=analyse.PrincipalStresses)
multiplication_2 = Multiplication(B=Slider(1000, range=0..1000))
sort_2 = SortList(Keys=vlen_2)  # -> Keys, ValuesA
mesh_3 = Mesh(mesh_2)
item_4 = ListItem(List=sort_2.Keys, Index=0, Wrap=True)  # -> Item1, Item
move_2 = Move(Geometry=demesh_4.Vertices, Motion=multiplication_2)  # -> Geometry, Transform
meshperface = CSharpScript(M=mesh_3)  # -> out, A; inputs M: Mesh
# ---------- meshperface: C# ----------
    List<Mesh> meshesOut = new List<Mesh>();
    foreach(MeshFace mf in M.Faces){
      Mesh meshToAdd = new Mesh();
      meshToAdd.Vertices.Add(M.Vertices[mf.A]);
      meshToAdd.Vertices.Add(M.Vertices[mf.B]);
      meshToAdd.Vertices.Add(M.Vertices[mf.C]);
      if(mf.IsQuad){
        meshToAdd.Vertices.Add(M.Vertices[mf.D]);
        meshToAdd.Faces.AddFace(new MeshFace(0, 1, 2, 3));
      } else {
        meshToAdd.Faces.AddFace(new MeshFace(0, 1, 2));
      }
      meshesOut.Add(meshToAdd);
    }
    A = meshesOut;
# ---------- end meshperface ----------
gradient = Gradient(
    LowerLimit=item_4.Item,
    UpperLimit=item_4.Item1,
    Parameter=vlen_2,
    stops=[0: RGB(39, 72, 161), 0.269: RGB(1, 192, 229), 0.435: RGB(18, 178, 90), 0.536: RGB(79, 186, 8), 0.733: RGB(220, 237, 32), 0.851: RGB(247, 159, 20), 1: RGB(243, 57, 0)])
conmesh_2 = ConstructMesh(Vertices=move_2.Geometry, Faces=demesh_4.Faces, Colours=gradient)
preview = CustomPreview(Geometry=meshperface.A, Shader=gradient)
medges_3 = MeshEdges(Mesh=conmesh_2)  # -> NakedEdges, InteriorEdges, NonManifoldEdges
merge = Merge(Data1=medges_3.NakedEdges, Data2=medges_3.InteriorEdges, Data3=medges_3.NonManifoldEdges)
