# Grasshopper definition Gurras_fittbro.gh (Grasshopper 0.9.76)
# plug-ins: MiStrAnGH

xz = XZPlane(Origin=Point(0, 0, 0))
number_slider = Slider(20, range=0..100)
srf = Surface(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)
mirror = Mirror(Geometry=srf, Plane=xz)  # -> Geometry, Transform
multiplication = Multiplication(A=number_slider, B=0.6)
int = Integer(multiplication)
mesh_uv = MeshSurface(Surface=[srf, mirror.Geometry], UCount=number_slider, VCount=int, Overhang=True, Equalize=False)
tri = Triangulate(Mesh=mesh_uv)  # -> Mesh, Count
mjoin = MeshJoin(Meshes=tri.Mesh)
mesh = Mesh(mjoin)
cullmesh = CullMesh(M=mesh)
medges = MeshEdges(Mesh=cullmesh)  # -> NakedEdges, InteriorEdges, NonManifoldEdges
mesh_2 = Mesh(cullmesh)
crv = Curve([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])
demesh = DeconstructMesh(Mesh=cullmesh)  # -> Vertices, Faces, Colours, Normals
facen = FaceNormals(Mesh=mesh_2)  # -> Centers, Normals
project = Project(Geometry=facen.Centers, Plane=PlaneXY(0, 0, 0))  # -> Geometry, Transform
pt = Point(demesh.Vertices)
incurves = PointInCurves(Point=project.Geometry, Curves=crv)  # -> Relationship, Index, Point
graftbyxcoord = GraftByXCoord(pt=pt)
equals = Equality(FirstNumber=incurves.Relationship, SecondNumber=2)  # -> Equality, Inequality
number_slider_2 = Slider(100, range=0..100)
cull = CullPattern(List=facen.Centers, CullPattern=invert(equals.Equality))
firstandlastbranch = FirstAndLAstBranch(pt=graftbyxcoord)  # -> pt_6, pt_5
cull_2 = CullPattern(List=facen.Centers, CullPattern=equals.Equality)
item = ListItem(List=pt, Index=[0, 1], Wrap=True)
support = CreateSupport(
    Point=flatten([firstandlastbranch.pt_6, firstandlastbranch.pt_5]),
    SupportInXDirection=True,
    SupportInYDirection=True,
    SupportInZDirection=True,
    SupportInXXDirection=True,
    SupportInYYDirection=True,
    SupportInZZDirection=True)
carbonfibre = Section(
    FaceCenterPoints=cull_2,
    EModulusInLongitudinalDirection_GPa=142,
    EModulusInTransverseDirection_GPA=7,
    LongitudinalShearModulus_GPA=7.2,
    PoissonsRatio=0.27,
    LaminaThickness_mm=[20, 1, 1, 20, 1, 1, 20],
    Angles_degree=[0, 45, -45, 0, -45, 45, 0],
    Density_kg_m_3=7800)
glassfibre = Section(
    FaceCenterPoints=cull,
    EModulusInLongitudinalDirection_GPa=45,
    EModulusInTransverseDirection_GPA=12,
    LongitudinalShearModulus_GPA=5.5,
    PoissonsRatio=0.19,
    LaminaThickness_mm=[2, 1, 1, 2, 1, 1, 2],
    Angles_degree=[0, 45, -45, 0, -45, 45, 0],
    Density_kg_m_3=7800)
pt_2 = Point(firstandlastbranch.pt_6)
support_2 = CreateSupport(
    Point=item,
    SupportInXDirection=True,
    SupportInYDirection=True,
    SupportInZDirection="false",
    SupportInXXDirection="false",
    SupportInYYDirection="false",
    SupportInZZDirection="false")
pt_3 = Point(firstandlastbranch.pt_5)
gravity = MiStrAnGravityLoad()
support_3 = CreateSupport(
    Point=pt_2,
    SupportInXDirection="false",
    SupportInYDirection="false",
    SupportInZDirection=True,
    SupportInXXDirection="false",
    SupportInYYDirection="false",
    SupportInZZDirection="false")
support_4 = CreateSupport(
    Point=pt_3,
    SupportInXDirection="false",
    SupportInYDirection="false",
    SupportInZDirection=True,
    SupportInXXDirection="false",
    SupportInYYDirection="false",
    SupportInZZDirection="false")
section = Section(
    EModulusInLongitudinalDirection_GPa=210,
    EModulusInTransverseDirection_GPA=210,
    LongitudinalShearModulus_GPA=79.3,
    PoissonsRatio=0.3,
    LaminaThickness_mm=10,
    Angles_degree=0,
    Density_kg_m_3=7800)
merge = Merge(Data1=support_3, Data2=support_4, Data3=support_2)  # -> flatten(Result)
number_slider_3 = Slider(0, range=0..100)
assemble = MiStrAnAssembleStructure(Mesh=mesh_2, MiStrAnSupports=flatten(merge), MiStrAnLoads=gravity, GeneratedSection=flatten(section))
panel = Panel("""-0.363684
-0.77566
-0.698889
-0.634023
-0.670584
-0.745447
0.74896
0.713766
0.724199
0.77203
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""")
deg = Degrees(Radians=panel)
analyse = MiStrAnAnalyseStructure(Run=Toggle(True), MiStrAnStructure=assemble)  # -> AnalysedStructure, Displacements, Rotations, Reactions, PrincipalStresses, PrincipalStressAngles, VonMisesStresses
pdecon = Deconstruct(Point=analyse.PrincipalStresses)  # -> XComponent, YComponent, ZComponent
abs = Absolute(Value=pdecon.XComponent)
abs_2 = Absolute(Value=pdecon.YComponent)
vlen = VectorLength(Vector=analyse.Displacements)
larger = LargerThan(FirstNumber=abs_2, SecondNumber=abs)  # -> LargerThan, OrEqualTo
int_2 = Integer([1, 1, 1, 1, 1, 1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])
bool = Boolean(larger.LargerThan)
sort = SortList(Keys=vlen)  # -> Keys, ValuesA
multiplication_2 = Multiplication(A=int_2, B=90)
addition = Addition(A=multiplication_2, B=deg)
item_2 = ListItem(List=sort.Keys, Index=0, Wrap=True)  # -> Item1, Item
visres = VisualiseResults(Structure=analyse.AnalysedStructure, ScaleDeformation=Slider(4, range=0..100))  # -> DeformedMesh, VonMisesStressPlot
drawprincarrows = DrawPrincipalstressArrows(Structure=analyse.AnalysedStructure)
panel_2 = Panel(item_2.Item1)
mesh_3 = Mesh(visres.VonMisesStressPlot)
drawcoordsys = DrawElementCoordinateSystem(Structure=assemble)
panel_3 = Panel("""24000: 0.098717
15360: 0.091232
8640: 0.082676
3840: 0.074125
960: 0.074079""")

# ==== cluster CullMesh
M = ClusterInput()
demesh = DeconstructMesh(Mesh=M)  # -> Vertices, Faces, Colours, Normals
deface = DeconstructFace(Face=demesh.Faces)  # -> CornerA, CornerB, CornerC, CornerD
cset = CreateSet(List=demesh.Vertices)  # -> Set, Map
index = ItemIndex(List=cset.Map, Item=cset.Map)
panel = Panel(cset.Map)
replace = ReplaceMembers(Set=deface.CornerB, Find=index, Replace=panel)
replace_2 = ReplaceMembers(Set=deface.CornerC, Find=index, Replace=panel)
replace_3 = ReplaceMembers(Set=deface.CornerA, Find=index, Replace=panel)
triangle = MeshTriangle(CornerA=replace_3, CornerB=replace, CornerC=replace_2)
conmesh = ConstructMesh(Vertices=cset.Set, Faces=triangle)
M_2 = ClusterOutput(conmesh)

# ==== cluster GraftByXCoord
pt = ClusterInput()
pt_2 = Point(pt)
pdecon = Deconstruct(Point=pt_2)  # -> XComponent, YComponent, ZComponent
cset = CreateSet(List=pdecon.XComponent)  # -> Set, Map
equals = Equality(FirstNumber=pdecon.XComponent, SecondNumber=graft(cset.Set))  # -> Equality, Inequality
cull = CullPattern(List=pt_2, CullPattern=equals.Equality)
pt_3 = Point(cull)
pt_4 = ClusterOutput(pt_3)

# ==== cluster FirstAndLAstBranch
pt = ClusterInput()
pt_2 = Point(pt)
tstat = TreeStatistics(Tree=pt_2)  # -> Paths, Length, Count
item = ListItem(List=tstat.Paths, Index=0, Wrap=True)  # -> Item1, Item
branch = TreeBranch(Tree=pt_2, Path=item.Item1, MaintainPaths=True)
branch_2 = TreeBranch(Tree=pt_2, Path=item.Item, MaintainPaths=True)
pt_3 = Point(branch_2)
pt_4 = Point(branch)
pt_5 = ClusterOutput(pt_3)
pt_6 = ClusterOutput(pt_4)
