# Grasshopper definition Komposit_verifiering.gh (Grasshopper 0.9.76)
# plug-ins: MiStrAnGH

number_slider = Slider(1, range=0..1)
pt = Point(Point(6.187004391, 14.76879502, 0))
rotate = Rotate(Center=Point(0, 0, 0), From=Vector(1, 0, 0), To=Vector(0, 1, 0))  # -> Geometry, Transform
vec = VectorXYZ(XComponent=number_slider, YComponent=number_slider, ZComponent=number_slider)  # -> Vector, Length
xy = XYPlane(Origin=Point(0, 0, 0))
xz = XZPlane(Origin=Point(0, 0, 0))
number_slider_2 = Slider(1, range=0..1)
number_slider_3 = Slider(10, range=0..10)
number_slider_4 = Slider(1, range=0..10)
pl = ConstructPlane(Origin=pt, XAxis=vec.Vector, YAxis=Vector(0, 1, 0))
X = UnitX(Factor=1)
prot = RotatePlane(Plane=xz, Angle=Slider(0.785, range=0..1))
pln = Plane(xy)
dom = ConstructDomain(DomainStart=expr("-x/2", number_slider_3), DomainEnd=expr("x/2", number_slider_3))
dom_2 = ConstructDomain(DomainStart=expr("-x/2", number_slider_4), DomainEnd=expr("x/2", number_slider_4))
number_slider_5 = Slider(3000, range=0..10000)
number_slider_6 = Slider(1000000, range=0..10000000)
number_slider_7 = Slider(10, range=0..1000)
number_slider_8 = Slider(1, range=0..10)
number_slider_9 = Slider(35.1, range=0..100)
addition = Addition(A=number_slider_8, B=1)
planesrf = PlaneSurface(Plane=pln, XSize=dom, YSize=dom_2)
rectangle = Rectangle(Plane=pln, XSize=dom, YSize=dom_2, Radius=0)  # -> Rectangle, Length
panel = Panel("""90
0
0
45
45
0
0
90""")
number_slider_10 = Slider(0.002, range=0..0.01)
division = Division(A=Slider(10000, range=0..10000), B=addition)
deplane = DeconstructPlane(Plane=pln)  # -> Origin, XAxis, YAxis, ZAxis
srf = Surface(planesrf)
repeat = RepeatData(Data=division, Length=addition)
mplane = MeshPlane(Boundary=rectangle.Rectangle, WidthCount=number_slider_7, HeightCount=number_slider_8)  # -> Mesh, Area
sdivide = DivideSurface(Surface=srf, UCount=number_slider_7, VCount=number_slider_8)  # -> simplify(Points), Normals, Parameters
tstat = TreeStatistics(Tree=sdivide.Points)  # -> Paths, Length, Count
tri = Triangulate(Mesh=mplane.Mesh)  # -> Mesh, Count
element_vectors = ElementVectors(mesh=tri.Mesh)  # -> V, V_2, V_3
v1 = Vector(element_vectors.V)
v2 = Vector(element_vectors.V_2)
v3 = Vector(element_vectors.V_3)
angle = Angle(VectorA=v1, VectorB=X)  # -> Angle, Reflex
deg = Degrees(Radians=angle.Angle)
item = ListItem(List=tstat.Paths, Index=0, Wrap=True)  # -> Item1, Item
panel_2 = Panel("0")
branch = TreeBranch(Tree=simplify(sdivide.Points), Path=item.Item, MaintainPaths=True)  # -> flatten(Branch)
branch_2 = TreeBranch(Tree=simplify(sdivide.Points), Path=item.Item1, MaintainPaths=True)  # -> flatten(Branch)
multiplication = Multiplication(A=deplane.ZAxis, B=repeat)
subtraction = Subtraction(A=panel, B=graft(deg))
vdis = VectorDisplay(Anchor=branch_2, Vector=unitize(multiplication))
X_2 = UnitX(Factor=Slider(1000000, range=0..1000000))
medges = MeshEdges(Mesh=tri.Mesh)  # -> NakedEdges, InteriorEdges, NonManifoldEdges
facen = FaceNormals(Mesh=tri.Mesh)  # -> Centers, Normals
support = CreateSupport(
    Point=branch,
    SupportInXDirection=True,
    SupportInYDirection=True,
    SupportInZDirection=True,
    SupportInXXDirection=True,
    SupportInYYDirection=True,
    SupportInZZDirection=True)
pointload = MiStrAnPointload(Point=branch_2, ForceVector=X_2)
panel_3 = Panel(multiplication)
section = Section(
    FaceCenterPoints=facen.Centers,
    EModulusInLongitudinalDirection_GPa=number_slider_9,
    EModulusInTransverseDirection_GPA=number_slider_9,
    LongitudinalShearModulus_GPA=Slider(7, range=0..10),
    PoissonsRatio=Slider(0.32, range=0..1),
    LaminaThickness_mm=Slider(10, range=0..10),
    Angles_degree=simplify(subtraction),
    Density_kg_m_3=7800)  # -> flatten(Generated)
section_2 = Section(
    EModulusInLongitudinalDirection_GPa=210,
    EModulusInTransverseDirection_GPA=210,
    LongitudinalShearModulus_GPA=79.3,
    PoissonsRatio=0.3,
    LaminaThickness_mm=10,
    Angles_degree=0,
    Density_kg_m_3=7800)
assemble = MiStrAnAssembleStructure(Mesh=tri.Mesh, MiStrAnSupports=support, MiStrAnLoads=pointload, GeneratedSection=section)
analyse = MiStrAnAnalyseStructure(Run=Toggle(True), MiStrAnStructure=assemble)  # -> AnalysedStructure, Displacements, Rotations, Reactions, PrincipalStresses
visres = VisualiseResults(Structure=analyse.AnalysedStructure, ScaleDeformation=Slider(236, range=0..1000))  # -> DeformedMesh, VonMisesStressPlot
panel_4 = Panel(deg)
mesh = Mesh(visres.DeformedMesh)
medges_2 = MeshEdges(Mesh=mesh)  # -> NakedEdges, InteriorEdges, NonManifoldEdges

# ==== cluster ElementVectors
mesh = ClusterInput()
mesh_2 = Mesh(mesh)
demesh = DeconstructMesh(Mesh=mesh_2)  # -> Vertices, Faces, Colours, Normals
deface = DeconstructFace(Face=demesh.Faces)  # -> CornerA, CornerB, CornerC, CornerD
item = ListItem(List=demesh.Vertices, Index=deface.CornerA, Wrap=True)
item_2 = ListItem(List=demesh.Vertices, Index=deface.CornerB, Wrap=True)
item_3 = ListItem(List=demesh.Vertices, Index=deface.CornerC, Wrap=True)
vec2pt = Vector2Pt(PointA=item, PointB=item_2, Unitize=True)  # -> Vector, Length
vec2pt_2 = Vector2Pt(PointA=item, PointB=item_3, Unitize=True)  # -> Vector, Length
v1 = Vector(vec2pt.Vector)
v2 = Vector(vec2pt_2.Vector)
xprod = CrossProduct(VectorA=v1, VectorB=v2, Unitize=False)  # -> Vector, Length
v3 = Vector(xprod.Vector)
xprod_2 = CrossProduct(VectorA=v3, VectorB=v1, Unitize=False)  # -> Vector, Length
v2_2 = Vector(xprod_2.Vector)
v1_2 = Vector(v1)
v2_3 = Vector(v2_2)
v3_2 = Vector(v3)
unit = UnitVector(Vector=v1_2)
unit_2 = UnitVector(Vector=v3_2)
unit_3 = UnitVector(Vector=v2_3)
V = ClusterOutput(unit)
V_2 = ClusterOutput(unit_3)
V_3 = ClusterOutput(unit_2)
