# Grasshopper definition SectionComponent.gh (Grasshopper 0.9.76)
# plug-ins: MiStrAnGH

number_slider = Slider(1, range=0..100)
number_slider_2 = Slider(1, range=0..1)
number_slider_3 = Slider(1, range=0..10)
xz = XZPlane(Origin=Point(0, 0, 0))
yz = YZPlane(Origin=Point(0, 0, 0))
xy = XYPlane(Origin=Point(0, 0, 0))
pln = Plane(xy)
dom = ConstructDomain(DomainStart=expr("-x/2", number_slider), DomainEnd=expr("x/2", number_slider))
dom_2 = ConstructDomain(DomainStart=expr("-x/2", number_slider), DomainEnd=expr("x/2", number_slider))
number_slider_4 = Slider(2, range=0..10)
rectangle = Rectangle(Plane=pln, XSize=dom, YSize=dom_2, Radius=0)  # -> Rectangle, Length
planesrf = PlaneSurface(Plane=pln, XSize=dom, YSize=dom_2)
mplane = MeshPlane(Boundary=rectangle.Rectangle, WidthCount=number_slider_4, HeightCount=number_slider_4)  # -> Mesh, Area
number_slider_5 = Slider(210, range=0..1000)
panel = Panel("""0.01
0.01""")
tri = Triangulate(Mesh=mplane.Mesh)  # -> Mesh, Count
demesh = DeconstructMesh(Mesh=tri.Mesh)  # -> Vertices, Faces, Colours, Normals
medges = MeshEdges(Mesh=tri.Mesh)  # -> NakedEdges, InteriorEdges, NonManifoldEdges
index = ItemIndex(List=demesh.Faces, Item=demesh.Faces)
section = Section(
    IndexesOfFaces=index,
    EModulusInLongitudinalDirection=number_slider_5,
    EModulusInTransverseDirection=number_slider_5,
    LongitudinalShearModulus=Slider(79.3, range=0..100),
    PoissonsRatio=Slider(0.3, range=0..1),
    LaminaThickness=panel,
    AnglesInDegree=Slider(0, range=0..100),
    Density_kg_m_3=Slider(0, range=0..100))
Z = UnitZ(Factor=1)
distload = MiStrAnDistributedLoad(CenterPoint=demesh.Vertices, ForceVector=Z)
support = CreateSupport(
    Point=demesh.Vertices,
    SupportInXDirection=True,
    SupportInYDirection=True,
    SupportInZDirection=True,
    SupportInXXDirection=True,
    SupportInYYDirection=True,
    SupportInZZDirection=True)
assemble = MiStrAnAssembleStructure(Mesh=mplane.Mesh, MiStrAnSupports=support, MiStrAnLoads=distload)
