# Grasshopper definition TestCase_beam_1x10x01m.gh (Grasshopper 0.9.76)
# plug-ins: MiStrAn

number_slider = Slider(10, range=0..10)
number_slider_2 = Slider(1, range=0..1)
dom = ConstructDomain(DomainStart=expr("-x/2", number_slider_2), DomainEnd=expr("x/2", number_slider_2))
dom_2 = ConstructDomain(DomainStart=expr("-x/2", number_slider), DomainEnd=expr("x/2", number_slider))
planesrf = PlaneSurface(Plane=PlaneXY(0, 0, 0), XSize=dom_2, YSize=dom)
number_slider_3 = Slider(4, range=0..100)
srf = Surface(planesrf)
multiplication = Multiplication(A=number_slider_3, B=10)
panel = Panel("""1250
2500
2500
2500
1250""")
sdivide = DivideSurface(Surface=srf, UCount=multiplication, VCount=number_slider_3)  # -> Points, Normals, Parameters
del = DelaunayMesh(Points=flatten(sdivide.Points), Plane=PlaneXY(0, 0, 0))
Z = UnitZ(Factor=-1)
branch = TreeBranch(Tree=simplify(sdivide.Points), Path=Slider(0, range=0..100), MaintainPaths=True)  # -> flatten(Branch)
branch_2 = TreeBranch(Tree=simplify(sdivide.Points), Path=Slider(40, range=0..100), MaintainPaths=True)  # -> flatten(Branch)
multiplication_2 = Multiplication(A=Z, B=panel)
medges = MeshEdges(Mesh=del)  # -> NakedEdges, InteriorEdges, NonManifoldEdges
mistran = MiStrAn(Run=False, Mesh=del, BC=branch, LoadPoints=branch_2, LoadVectors=multiplication_2)  # -> Displacements, Reactions
