# Grasshopper definition TestCase_beam_Mistran_sphere.gh (Grasshopper 0.9.76)
# plug-ins: Karamba, MiStrAn

number_slider = Slider(9, range=0..10)
number_slider_2 = Slider(9, range=0..10)
number_slider_3 = Slider(13, range=0..100)
number_slider_4 = Slider(3000, range=0..10000)
msphere = MeshSphere(Base=PlaneXY(0, 0, 0), Radius=10, UCount=number_slider_3, VCount=number_slider_3)
number_slider_5 = Slider(2, range=0..10)
tri = Triangulate(Mesh=msphere)  # -> Mesh, Count
addition = Addition(A=number_slider_5, B=1)
number_slider_6 = Slider(3, range=0..10)
medges = MeshEdges(Mesh=tri.Mesh)  # -> NakedEdges, InteriorEdges, NonManifoldEdges
deplane = DeconstructPlane(Plane=PlaneXY(0, 0, 0))  # -> Origin, XAxis, YAxis, ZAxis
number_slider_7 = Slider(2000, range=0..2000)
demesh = DeconstructMesh(Mesh=tri.Mesh)  # -> Vertices, Faces, Colours, Normals
series = Series(Start=0, Step=1, Count=Slider(3, range=0..10))
addition_2 = Addition(A=number_slider_5, B=1)
item = ListItem(List=demesh.Vertices, Index=series, Wrap=True)
division = Division(A=number_slider_7, B=addition_2)
addition_3 = Addition(A=number_slider_5, B=1)
number_slider_8 = Slider(1000000, range=0..10000000)
division_2 = Division(A=number_slider_8, B=addition)
repeat = RepeatData(Data=division_2, Length=addition)
multiplication = Multiplication(A=deplane.YAxis, B=repeat)
series_2 = Series(Start=expr("x*(x+1)", number_slider_5), Step=1, Count=expr("x+1", number_slider_5))
number_slider_9 = Slider(2, range=0..10)
points = PointList(Points=demesh.Vertices, Size=Slider(0.7, range=0..1))
series_3 = Series(Start=0, Step=1, Count=addition_3)
Y = UnitY(Factor=division)
number_slider_10 = Slider(500, range=0..1000)
Z = UnitZ(Factor=number_slider_7)
number_slider_11 = Slider(0, range=0..100)
X = UnitX(Factor=number_slider_8)
item_2 = ListItem(List=demesh.Vertices, Index=Slider(22, range=0..100), Wrap=True)
vdis = VectorDisplay(Anchor=item, Vector=deplane.YAxis)
panel = Panel(multiplication)
number_slider_12 = Slider(9, range=0..10)
panel_2 = Panel("""true
false
false
false
false
false""")
mistran = MiStrAn(Run=Toggle(True), Mesh=tri.Mesh, BC=item, LoadPoints=item_2, LoadVectors=X)  # -> Displacements, Reactions
panel_3 = Panel("""false
false
true
false
false
false""")
panel_4 = Panel("""false
true
false
false
false
false""")
multiplication_2 = Multiplication(A=mistran.Displacements, B=1000)
analyzethi = AnalyzeThIKaramba()  # -> CalculatedModel, MaximumDisplacement_m, ResultingForceOfGravity_kN, ElasticEnergy_kNm
cross_sections = CrossSectionsKaramba(Heights_cm=Slider(10, range=0..10), mode="Shell")
cull = CullPattern(CullPattern=panel_2)
cull_2 = CullPattern(List=multiplication_2, CullPattern=panel_4)
cull_3 = CullPattern(CullPattern=panel_3)
modelview = ModelViewKaramba(Model=analyzethi.CalculatedModel, LoadCaseFactorsForLinearSuperposition=1, IndexIncrementOfVisibleLoadcase=0)  # -> Model, DeformedMesh, DeformedAxes, DeformedModel
panel_5 = Panel(cull)
vec = VectorXYZ(XComponent=cull, YComponent=cull_2, ZComponent=cull_3)  # -> Vector, Length
panel_6 = Panel(cull_2)
nodedisp = NodalDisplacementsKaramba(AnalyzedModel=analyzethi.CalculatedModel)  # -> AnalyzedModel, NodalTranslations_m, NodalRotations_rad
mesh = Mesh(modelview.DeformedMesh)
vlen = VectorLength(Vector=vec.Vector)
multiplication_3 = Multiplication(A=nodedisp.NodalTranslations_m, B=1000)
sort = SortList(Keys=vlen)  # -> Keys, ValuesA
item_3 = ListItem(List=sort.Keys, Index=0, Wrap=True)  # -> Item1, Item
panel_7 = Panel(item_3.Item1)
