# Grasshopper definition kaponjar2.gh (Grasshopper 0.9.76)
# plug-ins: MiStrAnGH

pipeline = GeometryPipeline(
    GroupByLayer=False,
    GroupByType=False,
    IncludeHidden=True,
    IncludeLocked=True,
    LayerFilter="deckSidesLeft",
    NameFilter="*",
    TypeFilter=4)
pipeline_2 = GeometryPipeline(
    GroupByLayer=False,
    GroupByType=False,
    IncludeHidden=True,
    IncludeLocked=True,
    LayerFilter="deckSidesRight",
    NameFilter="*",
    TypeFilter=4)
pipeline_3 = GeometryPipeline(
    GroupByLayer=False,
    GroupByType=False,
    IncludeHidden=True,
    IncludeLocked=True,
    LayerFilter="sidingRight",
    NameFilter="*",
    TypeFilter=4)
pipeline_4 = GeometryPipeline(
    GroupByLayer=False,
    GroupByType=False,
    IncludeHidden=True,
    IncludeLocked=True,
    LayerFilter="sidingLeft",
    NameFilter="*",
    TypeFilter=4)
pipeline_5 = GeometryPipeline(
    GroupByLayer=False,
    GroupByType=False,
    IncludeHidden=True,
    IncludeLocked=True,
    LayerFilter="deck",
    NameFilter="*",
    TypeFilter=4)
pipeline_6 = GeometryPipeline(
    GroupByLayer=False,
    GroupByType=False,
    IncludeHidden=True,
    IncludeLocked=True,
    LayerFilter="underside_poly",
    NameFilter="*",
    TypeFilter=4)
end = EndPoints(Curve=[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])  # -> Start, End
end_2 = EndPoints(Curve=[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])  # -> Start, End
crv = Curve([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])
crv_2 = Curve([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])
crv_3 = Curve([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])
ln = Line(StartPoint=end.Start, EndPoint=end.End)
ln_2 = Line(StartPoint=end_2.Start, EndPoint=end_2.End)
crv_4 = Curve([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])
reb = RebuildCurve(Curve=crv_2, Count=10, Tangents=False)
reb_2 = RebuildCurve(Curve=crv, Count=3, Tangents=False)
reb_3 = RebuildCurve(Curve=crv_3, Count=10, Tangents=False)
sort_curves = SortCurves(crv=ln)
sort_curves_2 = SortCurves(crv=ln_2)
explode = Explode(Curve=reb_2, Recursive=True)  # -> Segments, Vertices
sort_curves_3 = SortCurves(crv=crv_4)
sort_curves_4 = SortCurves(crv=reb)
sort_curves_5 = SortCurves(crv=reb_3)
sort_curves_6 = SortCurves(crv=reb_2)
crv_5 = Curve(sort_curves)
crv_6 = Curve(sort_curves_2)
crv_7 = Curve(sort_curves_4)
crv_8 = Curve(sort_curves_6)
crv_9 = Curve(sort_curves_5)
crv_10 = Curve(sort_curves_3)
end_3 = EndPoints(Curve=crv_7)  # -> Start, End
loft = Loft(Curves=crv_10, Options={Adjust=False, Closed=False, LoftEnds=0, LoftSimp=0, LoftType=0, Rebuild=10, Refit=0.01})
loft_2 = Loft(Curves=crv_8, Options={Adjust=False, Closed=False, LoftEnds=0, LoftSimp=0, LoftType=0, Rebuild=10, Refit=0.01})
end_4 = EndPoints(Curve=crv_9)  # -> Start, End
intcrv = Interpolate(Vertices=end_3.End, Degree=3, Periodic=False, KnotStyle=1)  # -> Curve, Length, Domain
rails = Curve(intcrv.Curve)
get_rails = GetRails_2(brep=loft_2)
get_rails_2 = GetRails(brep=loft)
rails_2 = Curve(get_rails_2)
rails_3 = Curve(get_rails_2)
intcrv_2 = Interpolate(Vertices=end_4.Start, Degree=3, Periodic=False, KnotStyle=1)  # -> Curve, Length, Domain
rails_4 = Curve(intcrv_2.Curve)
item = ListItem(List=rails_2, Index=1, Wrap=True)
item_2 = ListItem(List=rails_3, Index=0, Wrap=True)
rails_5 = Curve(get_rails)
rails_6 = Curve(rails_5)
item_3 = ListItem(List=rails_6, Index=0, Wrap=True)  # -> Item, Item1
flip = FlipCurve(Curve=item_3.Item1)  # -> Curve, Flag
swp2 = Sweep2(Rail1=flip.Curve, Rail2=rails_4, Sections=crv_5, SameHeight=False)
swp2_2 = Sweep2(Rail1=rails, Rail2=item_3.Item, Sections=crv_6, SameHeight=False)
end_5 = EndPoints(Curve=item)  # -> Start, End
flip_2 = FlipCurve(Curve=item)  # -> Curve, Flag
swp2_3 = Sweep2(Rail1=flip_2.Curve, Rail2=intcrv.Curve, Sections=crv_7, SameHeight=False)
swp2_4 = Sweep2(Rail1=item_2, Rail2=intcrv_2.Curve, Sections=crv_9, SameHeight=False)
custom_mesh_settings = SettingsCustom(
    StitchSeams=True,
    SimplePlanes=False,
    Refine=True,
    MinCount=16,
    MaxCount=400,
    AspectRatio=Slider(1, range=0..10),
    MaxDistance=0,
    MaxAngle=20,
    MinEdge=0,
    MaxEdge=0)
merge = Merge(Data1=loft, Data2=loft_2, Data3=swp2_4, Data4=swp2_3, Data5=swp2, Data6=swp2_2)  # -> flatten(Result)
join = BrepJoin(Breps=merge)  # -> Breps, Closed
mesh = MeshBrep(
    Brep=join.Breps,
    Settings={GridMaxCount=0, GridMinCount=16, JaggedSeams=False, MaxEdgeLength=0, MinEdgeLength=0.0001, MinTolerance=0, Refine=False, RefineAngle=0, RelativeTolerance=0.65, SimplePlanes=True, Tolerance=0})
tri = Triangulate(Mesh=mesh)  # -> Mesh, Count
cullmesh = CullMesh(M=tri.Mesh)
mesh_2 = Mesh(cullmesh)
demesh = DeconstructMesh(Mesh=mesh_2)  # -> Vertices, Faces, Colours, Normals
pdecon = Deconstruct(Point=demesh.Vertices)  # -> XComponent, YComponent, ZComponent
medges = MeshEdges(Mesh=cullmesh)  # -> NakedEdges, InteriorEdges, NonManifoldEdges
sort = SortList(Keys=pdecon.ZComponent, ValuesA=demesh.Vertices)  # -> Keys, ValuesA
series = Series(Start=0, Step=1, Count=Slider(70, range=0..100))
pt = Point([Point(34.25, -2.067759991, 2.279552221), Point(34.25, -2.092728376, 2.195645332), Point(34.25, -2.085594654, 2.219618559), Point(34.25, -2.078460693, 2.243592024), Point(34.25, -2.071326971, 2.267565489), Point(34.25, -2.064193249, 2.291538715)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])
pt_2 = Point([Point(-11.97452927, -1.786750555, 1.679330349), Point(-11.3770504, -0.8951234818, 1.673700571), Point(-10.77957058, -0.003496399382, 1.668070793), Point(-10.18209076, 0.8881306648, 1.662441015), Point(-9.584611893, 1.779757738, 1.656811357), Point(-8.987132072, 2.671384811, 1.651181579), Point(-12.81672478, -3.043570757, 1.750768423), Point(-12.7351532, -2.921839714, 1.728832364), Point(-12.57200909, -2.678377628, 1.684960127)])
item_4 = ListItem(List=sort.ValuesA, Index=series, Wrap=True)
support = CreateSupport(
    Point=pt,
    SupportInXDirection="false",
    SupportInYDirection="false",
    SupportInZDirection=True,
    SupportInXXDirection="false",
    SupportInYYDirection="false",
    SupportInZZDirection="false")
support_2 = CreateSupport(
    Point=pt_2,
    SupportInXDirection=True,
    SupportInYDirection="false",
    SupportInZDirection="false",
    SupportInXXDirection="false",
    SupportInYYDirection="false",
    SupportInZZDirection="false")
support_3 = CreateSupport(
    Point=item_4,
    SupportInXDirection="false",
    SupportInYDirection=True,
    SupportInZDirection=True,
    SupportInXXDirection="false",
    SupportInYYDirection="false",
    SupportInZZDirection="false")
gravity = MiStrAnGravityLoad()
section = Section(
    EModulusInLongitudinalDirection_GPa=210,
    EModulusInTransverseDirection_GPA=210,
    LongitudinalShearModulus_GPA=79.3,
    PoissonsRatio=0.3,
    LaminaThickness_mm=10,
    Angles_degree=0,
    Density_kg_m_3=7800)
assemble = MiStrAnAssembleStructure(Mesh=mesh_2, MiStrAnSupports=flatten([support_3, support_2, support]), MiStrAnLoads=gravity, GeneratedSection=section)
analyse = MiStrAnAnalyseStructure(Run=Toggle(False), MiStrAnStructure=assemble)  # -> AnalysedStructure, Displacements, Rotations, Reactions, PrincipalStresses, PrincipalStressAngles, VonMisesStresses
sort_2 = SortList(Keys=analyse.VonMisesStresses)  # -> Keys, ValuesA
vlen = VectorLength(Vector=analyse.Displacements)
number_slider = Slider(100, range=0..100)
number_slider_2 = Slider(21, range=0..100)
number_slider_3 = Slider(1, range=0..1)
sort_3 = SortList(Keys=vlen)  # -> Keys, ValuesA
number_slider_4 = Slider(500, range=0..1000)
number_slider_5 = Slider(5000, range=0..10000)
visres = VisualiseResults(Structure=analyse.AnalysedStructure, ScaleDeformation=100, BottomLimiter=0, TopLimiter=Slider(0.1, range=0..1))  # -> DeformedMesh, VonMisesStressPlot
drawprincarrows = DrawPrincipalstressArrows(Structure=analyse.AnalysedStructure)
get_stressed_elements = GetStressedElements(
    MeshToEvaluate=mesh_2,
    PrincipalStressesVector=analyse.PrincipalStresses,
    NbOfHighestStressedElements=Slider(3000, range=0..100000))  # -> NbElementsWithHighestStresses, TheRestOfTheStresses
mesh_3 = Mesh(visres.VonMisesStressPlot)
pt_3 = Point(get_stressed_elements.NbElementsWithHighestStresses)

# ==== cluster SortCurves
crv = ClusterInput()
crv_2 = Curve(crv)
curvepoint = PointOnCurve(crv_2, parameter=0.5)
pdecon = Deconstruct(Point=curvepoint)  # -> XComponent, YComponent, ZComponent
sort = SortList(Keys=pdecon.XComponent, ValuesA=crv_2)  # -> Keys, ValuesA
crv_3 = Curve(sort.ValuesA)
crv_4 = ClusterOutput(crv_3)

# ==== cluster GetRails
brep = ClusterInput()
brep_2 = Brep(brep)
edges = BrepEdges(Brep=brep_2)  # -> Naked, Interior, NonManifold
panel = Panel("""0
1
4
5""")
join = JoinCurves(Curves=edges.Naked, Preserve=False)
disc = Discontinuity(Curve=join, Level=1)  # -> Points, Parameters
item = ListItem(List=disc.Parameters, Index=panel, Wrap=True)
shatter = Shatter(Curve=join, Parameters=item)
cull = CullPattern(List=shatter, CullPattern=[True, False])
crv = Curve(cull)
crv_2 = ClusterOutput(crv)

# ==== cluster GetRails_2
brep = ClusterInput()
brep_2 = Brep(brep)
edges = BrepEdges(Brep=brep_2)  # -> Naked, Interior, NonManifold
panel = Panel("""0
1
3
4""")
join = JoinCurves(Curves=edges.Naked, Preserve=False)
disc = Discontinuity(Curve=join, Level=1)  # -> Points, Parameters
item = ListItem(List=disc.Parameters, Index=panel, Wrap=True)
shatter = Shatter(Curve=join, Parameters=item)
cull = CullPattern(List=shatter, CullPattern=[True, False])
crv = Curve(cull)
crv_2 = ClusterOutput(crv)

# ==== cluster CullMesh
M = ClusterInput()
demesh = DeconstructMesh(Mesh=M)  # -> Vertices, Faces, Colours, Normals
deface = DeconstructFace(Face=demesh.Faces)  # -> CornerA, CornerB, CornerC, CornerD
cset = CreateSet(List=demesh.Vertices)  # -> Set, Map
index = ItemIndex(List=cset.Map, Item=cset.Map)
panel = Panel(cset.Map)
replace = ReplaceMembers(Set=deface.CornerB, Find=index, Replace=panel)
replace_2 = ReplaceMembers(Set=deface.CornerC, Find=index, Replace=panel)
replace_3 = ReplaceMembers(Set=deface.CornerA, Find=index, Replace=panel)
triangle = MeshTriangle(CornerA=replace_3, CornerB=replace, CornerC=replace_2)
conmesh = ConstructMesh(Vertices=cset.Set, Faces=triangle)
M_2 = ClusterOutput(conmesh)
