# Grasshopper definition testSimple2.gh (Grasshopper 0.9.76)
# plug-ins: MiStrAn

number_slider = Slider(2, range=0..10)
mplane = MeshPlane(
    Boundary={Plane=PlaneXY(0, 0, 0), Size=Domain2(u=-10..10, v=-10..10)},
    WidthCount=number_slider,
    HeightCount=number_slider)  # -> Mesh, Area
mesh = Mesh(mplane.Mesh)
demesh = DeconstructMesh(Mesh=mesh)  # -> Vertices, Faces, Colours, Normals
points = PointList(Points=demesh.Vertices, Size=Slider(3, range=0..10))
hull = ConvexHull(Points=demesh.Vertices, Plane=PlaneXY(0, 0, 0))  # -> Hull, HullZ, Indices
crv_cp = CurveClosestPoint(Point=demesh.Vertices, Curve=hull.Hull)  # -> Point, Parameter, Distance
smaller = SmallerThan(FirstNumber=crv_cp.Distance, SecondNumber=Slider(0.001, range=0..0.001))  # -> SmallerThan, OrEqualTo
cull = CullPattern(List=demesh.Vertices, CullPattern=smaller.SmallerThan)
cull_2 = CullPattern(List=demesh.Vertices, CullPattern=invert(smaller.SmallerThan))
mistran = MiStrAn(Mesh=mesh, BC=cull, Load=cull_2)
